# Grasshopper definition massing.gh (Grasshopper 1.0.7)

panel = Panel("内置若干参数化体量模板")
size_x = GetNumber(Slider(65.5, range=0..100), AtLeast=1, AtMost=1, Maximum=1.797693135e+308, Minimum=-1.797693135e+308, TreeAccess=False)
floor_count = GetInteger(Slider(12, range=0..100), AtLeast=1, AtMost=1, Maximum=2147483647, Minimum=-2147483648, TreeAccess=False)
size_y = GetNumber(Slider(75.6, range=0..100), AtLeast=1, AtMost=1, Maximum=1.797693135e+308, Minimum=-1.797693135e+308, TreeAccess=False)
building_area = GetInteger(Slider(8000, range=0..10000), AtLeast=1, AtMost=1, Maximum=2147483647, Minimum=-2147483648, TreeAccess=False)
massing_index = GetInteger(Slider(0, range=0..10), AtLeast=1, AtMost=1, Maximum=2147483647, Minimum=-2147483648, TreeAccess=False)
geo = Geometry([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])
scale_nu = ScaleNU(Geometry=geo, Plane=PlaneXY(0, 0, 0), ScaleX=1, ScaleY=1, ScaleZ=1)  # -> Geometry, Transform
geo_2 = Geometry(scale_nu.Geometry)
context_bake = ContextBake(Geometry=geo_2)
