# Grasshopper definition sunlight.gh (Grasshopper 1.0.7)

file_path = FilePath("F:\SEU\2026\simulation\CHN_Jiangsu.Nanjing.582380_CSWD\CHN_Jiangsu.Nanjing.582380_CSWD.epw")
importepw = LBImportEPW(epw_file=file_path)  # -> location, dry_bulb_temperature, dew_point_temperature, relative_humidity, wind_speed, wind_direction, direct_normal_rad, diffuse_horizontal_rad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; plug-in component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

# ---- group: SUN PATH
importepw_2 = LBImportEPW(epw_file=file_path)  # -> location, dry_bulb_temperature, dew_point_temperature, relative_humidity, wind_speed, wind_direction, direct_normal_rad, diffuse_horizontal_rad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; disabled; plug-in component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
number_slider = Slider(22, range=0..100)  # disabled
number_slider_2 = Slider(0, range=0..100)  # disabled
number_slider_3 = Slider(12, range=0..100)  # disabled
number_slider_4 = Slider(10, range=0..100)  # disabled
analysisperiod = LBAnalysisPeriod(
    start_month=number_slider_3,
    start_day=number_slider,
    start_hour=0,
    end_month=number_slider_3,
    end_day=number_slider,
    timestep=number_slider_2)  # -> period, hoys, dates; disabled; plug-in component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
point = Point(<point referenced from the Rhino model>)  # disabled
sunpath = LBSunPath(location=importepw_2.location, hoys=analysisperiod.hoys, center_pt=point, scale=number_slider_4)  # -> out, vectors, altitudes, azimuths, hoys, sun_pts, analemma, daily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; disabled; plug-in component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
number_slider_5 = Slider(50, range=0..100)  # disabled
geometry = Geometry([sunpath.analemma, sunpath.daily, sunpath.compass, sunpath.legend, sunpath.title, sunpath.color_pts])  # disabled
colour_swatch = ColourSwatch(SwatchColor=RGB(0, 0, 0))  # disabled
sphere = Sphere(Base=sunpath.sun_pts, Radius=number_slider_5)  # disabled
custom_preview = CustomPreview(Geometry=geometry, Material=colour_swatch)  # disabled
geometry_2 = Geometry(sphere)  # disabled

# ----
number_slider_6 = Slider(22, range=0..100)
number_slider_7 = Slider(12, range=0..100)
analysisperiod_2 = LBAnalysisPeriod(
    start_month=number_slider_7,
    start_day=number_slider_6,
    start_hour=0,
    end_month=number_slider_7,
    end_day=number_slider_6,
    timestep=Slider(12, range=0..100))  # -> period, hoys, dates; plug-in component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

geo = Geometry([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])
srf = Surface(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)

area = Area(Geometry=srf)  # -> Area, Centroid
sunpath_2 = LBSunPath(location=importepw.location, hoys=analysisperiod_2.hoys, center_pt=area.Centroid, scale=Slider(10, range=0..100))  # -> out, vectors, altitudes, azimuths, hoys, sun_pts, analemma, daily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; plug-in component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
preview = CustomPreview(Geometry=geo, Material=ColourSwatch(SwatchColor=RGB(255, 255, 255)))
merge = Merge(Data1=ColourSwatch(SwatchColor=RGB(40, 0, 158)), Data2=ColourSwatch(SwatchColor=RGB(194, 0, 0)))
legendpar = LBLegendParameters(
    min=Slider(0, range=0..100),
    max=Slider(8, range=0..10),
    seg_count=Slider(17, range=0..100),
    num_decimals=Slider(1, range=0..1))  # -> leg_par; plug-in component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
directsunhours = LBDirectSunHours(
    vectors=flatten(sunpath_2.vectors),
    timestep=Slider(12, range=0..100),
    geometry=flatten(srf),
    context=flatten(geo),
    grid_size=Slider(3.5, range=0..10),
    offset_dist=Slider(0.1, range=0..1),
    legend_par=legendpar,
    run=Toggle(True))  # -> out, points, results, mesh, legend, title, int_mtx; plug-in component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
